# Dynamo graph Step 5 IDEF0 fixet.dyn (Dynamo 2.5.0.7460)
# packages: BumbleBee 2021.25.3, Data-Shapes 2021.2.91, DynamoMEP 1.0.1, archi-lab.net 2021.25.17

# group: Læs Excel
file_path = Filename(".\Step 5 IDEF0.xlsm")
boolean = BoolSelector(true)
string = StringInput("Luftmængder")
boolean_2 = BoolSelector(true)
string_2 = StringInput("A2")
read_excel = Custom[Read Excel](filePath=file_path, runIt=boolean, sheetName=string, byColumn=boolean_2, origin=string_2)  # package BumbleBee; This node will read an excel file. You can read an entore sheet contents, read from specific origin cell, read only specific range, or do all of the former for multiple sheets at the same time.

# group: Alle kanaler og spaces
categories = Categories("OST_DuctCurves")  # graph input
all_elements_of_category = ElementsOfCategory(Category=categories)
categories_2 = Categories("OST_MEPSpaces")  # graph input
all_elements_of_category_2 = ElementsOfCategory(Category=categories_2)
categories_3 = Categories("OST_Rooms")  # graph input
all_elements_of_category_3 = ElementsOfCategory(Category=categories_3)
name = archilab.Revit.Elements.Room.Name(room=all_elements_of_category_3)
setName = Space.SetName(space=all_elements_of_category_2, value=name)

space_1 = CodeBlock { 0; }
getItemAtIndex = List.GetItemAtIndex(list=all_elements_of_category_2, index=space_1)
indvendig_diameter = CodeBlock { 8; }

# group: Kolonner i Excel
name_2 = CodeBlock { 0; }
getItemAtIndex_2 = List.GetItemAtIndex(list=read_excel, index=name_2)
number = CodeBlock { 1; }
getItemAtIndex_3 = List.GetItemAtIndex(list=read_excel, index=number)
specified_return_airflow = CodeBlock { 3; }
getItemAtIndex_4 = List.GetItemAtIndex(list=read_excel, index=specified_return_airflow)
room_department = CodeBlock { 5; }
getItemAtIndex_5 = List.GetItemAtIndex(list=read_excel, index=room_department)
getItemAtIndex_6 = List.GetItemAtIndex(list=read_excel, index=indvendig_diameter)
room_department_2 = CodeBlock { 6; }
getItemAtIndex_7 = List.GetItemAtIndex(list=read_excel, index=room_department_2)
min_ind_diameter = CodeBlock { 8; }
getItemAtIndex_8 = List.GetItemAtIndex(list=read_excel, index=min_ind_diameter)
specified_supply_airflow = CodeBlock { 2; }
getItemAtIndex_9 = List.GetItemAtIndex(list=read_excel, index=specified_supply_airflow)
area = CodeBlock { 4; }
getItemAtIndex_10 = List.GetItemAtIndex(list=read_excel, index=area)

# group: Opdeling af diameter liste
indvendig_diameter_2 = CodeBlock { 0; }
getItemAtIndex_11 = List.GetItemAtIndex(list=getItemAtIndex_6, index=indvendig_diameter_2)
indvendig_diameter_3 = CodeBlock { 1; }
getItemAtIndex_12 = List.GetItemAtIndex(list=getItemAtIndex_6, index=indvendig_diameter_3)
indvendig_diameter_4 = CodeBlock { 2; }
getItemAtIndex_13 = List.GetItemAtIndex(list=getItemAtIndex_6, index=indvendig_diameter_4)
indvendig_diameter_5 = CodeBlock { 3; }
getItemAtIndex_14 = List.GetItemAtIndex(list=getItemAtIndex_6, index=indvendig_diameter_5)

# group: Data-Shapes
string_3 = StringInput("Udvælg rum")
string_4 = StringInput("Vælg rum")
categories_4 = Categories("OST_Rooms")  # frozen
all_elements_of_category_4 = ElementsOfCategory(Category=categories_4)
name_3 = Room.Name(room=all_elements_of_category_4)
boolean_3 = BoolSelector(true)
listview_data = Custom[Listview Data](Keys=name_3, Values=all_elements_of_category_4, HilightInView_optionnal=boolean_3)  # package Data-Shapes; Create data for ListView input in UI.MultiInputForm ++ . Check out www.data-shapes.net for more infos.
boolean_4 = BoolSelector(true)
string_5 = StringInput("Annuller")
multipleinputform = Custom[MultipleInputForm ++](Description_optional=string_3, ButtonText_optional=string_4, Inputs=listview_data, Toggle=boolean_4, CancelButtonText_optional=string_5)  # package Data-Shapes; Create a form with multiple inputs. see www.data-shapes.net for tutorials and infos!

space_2 = CodeBlock { 1; }
getItemAtIndex_15 = List.GetItemAtIndex(list=all_elements_of_category_2, index=space_2)
space_3 = CodeBlock { 2; }
getItemAtIndex_16 = List.GetItemAtIndex(list=all_elements_of_category_2, index=space_3)
space_4 = CodeBlock { 3; }
getItemAtIndex_17 = List.GetItemAtIndex(list=all_elements_of_category_2, index=space_4)

# group: Find ventilationselementer i individuelle spaces
listFlatten = Python(IN[0]=getItemAtIndex)  # "py.ListFlatten"
# ---------- listFlatten.python (44 lines) ----------
import clr
import sys
sys.path.append('C:\Program Files (x86)\IronPython 2.7\Lib')
import System
from System import Array
from System.Collections.Generic import *
clr.AddReference('ProtoGeometry')
from Autodesk.DesignScript.Geometry import *
clr.AddReference("RevitNodes")
import Revit
clr.ImportExtensions(Revit.Elements)
clr.ImportExtensions(Revit.GeometryConversion)
clr.AddReference("RevitServices")
import RevitServices
from RevitServices.Persistence import DocumentManager
from RevitServices.Transactions import TransactionManager

clr.AddReference("RevitAPI")
clr.AddReference("RevitAPIUI")

import Autodesk
from Autodesk.Revit.DB import *
from Autodesk.Revit.UI import *
import collections

doc = DocumentManager.Instance.CurrentDBDocument
uiapp = DocumentManager.Instance.CurrentUIApplication
app = uiapp.Application
uidoc = uiapp.ActiveUIDocument


#Inputs
unflattened_list = IN[0]

#Type code bellow

def flattenList(unflattened_list):
	if isinstance(unflattened_list,collections.Iterable):
		return [sub_element for element in unflattened_list for sub_element in flattenList(element)]
	else:
		return [unflattened_list]

#Output
OUT = flattenList(IN[0])
# ----------------------------------------
elements_in_space = Custom[Elements in Space](element=all_elements_of_category, space=listFlatten)  # package archi-lab.net; This node will take an input of Spaces and Elements and attempt to group all elements by Room that it is located in. For elements that are placed by Line and not a Point, a mid point of line will be used to determine location.
listFlatten_2 = Python(IN[0]=getItemAtIndex_15)  # "py.ListFlatten"; same code as listFlatten
elements_in_space_2 = Custom[Elements in Space](element=all_elements_of_category, space=listFlatten_2)
listFlatten_3 = Python(IN[0]=getItemAtIndex_16)  # "py.ListFlatten"; same code as listFlatten
elements_in_space_3 = Custom[Elements in Space](element=all_elements_of_category, space=listFlatten_3)
listFlatten_4 = Python(IN[0]=getItemAtIndex_17)  # "py.ListFlatten"; same code as listFlatten
elements_in_space_4 = Custom[Elements in Space](element=all_elements_of_category, space=listFlatten_4)

# group: Overfør resultat til Revit
code_block = CodeBlock { "Diameter"; }
setParameterByName = Element.SetParameterByName(element=elements_in_space, parameterName=code_block, value=getItemAtIndex_11)

# group: Overfør resultat til Revit
code_block_2 = CodeBlock { "Diameter"; }
setParameterByName_2 = Element.SetParameterByName(element=elements_in_space_2, parameterName=code_block_2, value=getItemAtIndex_12)

# group: Overfør resultat til Revit
code_block_3 = CodeBlock { "Diameter"; }
setParameterByName_3 = Element.SetParameterByName(element=elements_in_space_3, parameterName=code_block_3, value=getItemAtIndex_13)

# group: Overfør resultat til Revit
code_block_4 = CodeBlock { "Diameter"; }
setParameterByName_4 = Element.SetParameterByName(element=elements_in_space_4, parameterName=code_block_4, value=getItemAtIndex_14)

# group: Opret spaces på rum
categories_5 = Categories("OST_Rooms")
all_elements_of_category_5 = ElementsOfCategory(Category=categories_5)
location = Room.Location(room=all_elements_of_category_5)
byPoint = DynamoMEP.Space.ByPoint(point=location)

# group: Overfør resultat til Revit
categories_6 = Categories("OST_MEPSpaces")
all_elements_of_category_6 = ElementsOfCategory(Category=categories_6)
code_block_5 = CodeBlock { "Specified Supply Airflow"; }
clean = List.Clean(list=getItemAtIndex_9)
remove_units = Python(IN[0]=clean)  # "py.remove_units"
# ---------- remove_units.python (49 lines) ----------
import clr
import sys
sys.path.append('C:\Program Files (x86)\IronPython 2.7\Lib')
import System
from System import Array
from System.Collections.Generic import *
clr.AddReference('ProtoGeometry')
from Autodesk.DesignScript.Geometry import *
clr.AddReference("RevitNodes")
import Revit
clr.ImportExtensions(Revit.Elements)
clr.ImportExtensions(Revit.GeometryConversion)
clr.AddReference("RevitServices")
import RevitServices
from RevitServices.Persistence import DocumentManager
from RevitServices.Transactions import TransactionManager

clr.AddReference("RevitAPI")
clr.AddReference("RevitAPIUI")

import Autodesk
from Autodesk.Revit.DB import *
from Autodesk.Revit.UI import *

doc = DocumentManager.Instance.CurrentDBDocument
uiapp = DocumentManager.Instance.CurrentUIApplication
app = uiapp.Application
uidoc = uiapp.ActiveUIDocument


flowWithUnitsList = IN[0]

#Type code bellow
flowWithoutUnitsList = []
outputList = []

for i in flowWithUnitsList[:]:
	data = i.split() #i.replace(",",".")
	flowWithoutUnitsList.append(data)

for list in flowWithoutUnitsList[:]:
	#list[0].replace(",", ".")
	del list[1]

for list in flowWithoutUnitsList[:]:
	list[0].replace(",", ".")

#Output
OUT = flowWithoutUnitsList
# ----------------------------------------
flatten = List.Flatten(list=remove_units)
code_block_6 = CodeBlock { ","; "."; }
replace = String.Replace(str=flatten, searchFor=code_block_6.out0, replaceWith=code_block_6.out1)
toNumber = String.ToNumber(str=replace)
setParameterByName_5 = Element.SetParameterByName(element=all_elements_of_category_6, parameterName=code_block_5, value=toNumber)

# group: Overfør resultat til Revit
categories_7 = Categories("OST_MEPSpaces")
all_elements_of_category_7 = ElementsOfCategory(Category=categories_7)
code_block_7 = CodeBlock { "Specified Exhaust Airflow"; }
clean_2 = List.Clean(list=getItemAtIndex_10)
remove_units_2 = Python(IN[0]=clean_2)  # "py.remove_units"; same code as remove_units
flatten_2 = List.Flatten(list=remove_units_2)
code_block_8 = CodeBlock { ","; "."; }
replace_2 = String.Replace(str=flatten_2, searchFor=code_block_8.out0, replaceWith=code_block_8.out1)
toNumber_2 = String.ToNumber(str=replace_2)
setParameterByName_6 = Element.SetParameterByName(element=all_elements_of_category_7, parameterName=code_block_7, value=toNumber_2)
